# Grasshopper definition 220210_Cocoon_V.1.gh (Grasshopper 1.0.7)
# plug-ins: MarchingCubes

panel = Panel("CURVE + POINT CHARGE")

# ---- group: BOX CONSTRUCTION
number_slider = Slider(21, range=0..100)
number_slider_2 = Slider(18, range=0..100)
number_slider_3 = Slider(19, range=0..100)

# ----
z_axis = GetInteger(number_slider_3, AtLeast=1, AtMost=1, Maximum=2147483647, Minimum=-2147483648)
y_axis = GetInteger(number_slider_2, AtLeast=1, AtMost=1, Maximum=2147483647, Minimum=-2147483648)
x_axis = GetInteger(number_slider, AtLeast=1, AtMost=1, Maximum=2147483647, Minimum=-2147483648)

# ---- group: BOX CONSTRUCTION (continued)
multiplication = Multiplication(A=z_axis, B=Slider(-1, range=-15..15))
multiplication_2 = Multiplication(A=x_axis, B=Slider(-1, range=-15..15))
multiplication_3 = Multiplication(A=y_axis, B=Slider(-1, range=-15..15))
dom = ConstructDomain(DomainStart=multiplication, DomainEnd=z_axis)
dom_2 = ConstructDomain(DomainStart=multiplication_2, DomainEnd=x_axis)
dom_3 = ConstructDomain(DomainStart=multiplication_3, DomainEnd=y_axis)
box = DomainBox(Base=PlaneXY(0, 0, 0), X=dom_2, Y=dom_3, Z=dom)

# ---- group: CURVE CONNECTIONS
debrep = DeconstructBrep(Brep=box)  # -> Faces, Edges, Vertices
number_slider_4 = Slider(6, range=0..10)
number_slider_5 = Slider(10, range=0..10)
item = ListItem(List=debrep.Faces, Index=Slider(4, range=0..6), Wrap=True)
item_2 = ListItem(List=debrep.Faces, Index=Slider(5, range=0..6), Wrap=True)
wires = BrepWireframe(Brep=item, Density=-1)
number_slider_6 = Slider(6, range=0..10)
wires_2 = BrepWireframe(Brep=item_2, Density=-1)
join = JoinCurves(Curves=wires, Preserve=False)
join_2 = JoinCurves(Curves=wires_2, Preserve=False)
Z = UnitZ(Factor=Slider(10, range=0..10))
rev = Reverse(Vector=Z)

# ----
top = GetInteger(number_slider_5, AtLeast=1, AtMost=1, Maximum=2147483647, Minimum=-2147483648)
base = GetInteger(number_slider_4, AtLeast=1, AtMost=1, Maximum=2147483647, Minimum=-2147483648)

# ---- group: CURVE CONNECTIONS (continued)
pop2d = Populate2D(Region=join, Count=number_slider_6, Seed=base)
pop2d_2 = Populate2D(Region=join_2, Count=number_slider_6, Seed=top)
bzspan = BezierSpan(StartPoint=pop2d, StartTangent=Z, EndPoint=pop2d_2, EndTangent=rev)  # -> Curve, Length, Domain

# ---- group: CURVE CHARGE
dom_4 = ConstructDomain(DomainStart=Slider(15, range=0..100), DomainEnd=Slider(5, range=0..100))
random = Random(Range=dom_4, Number=number_slider_6, Seed=2)
curve_charge = CurveCharge(Curve=bzspan.Curve, Radius=random, ChargeStrengths=Slider(1, range=0..1))

# ----
join_curves = JoinCurves(Curves=wires, Preserve=False)

# ---- group: solver
cocoon = Cocoon(Charges=curve_charge, Iso=Slider(0.2, range=0..1), CellSize=Slider(1, range=0..1), Execute=Toggle(True), Simple=False)  # -> Mesh, RefinementData

# ----
offset_curve = OffsetCurve(Curve=join_curves, Distance=expr("X+5", 1), Corners=1)
mesh = Mesh(cocoon.Mesh)

medges = MeshEdges(Mesh=mesh)  # -> NakedEdges, InteriorEdges, NonManifoldEdges
join_3 = JoinCurves(Curves=medges.InteriorEdges, Preserve=False)
merge = Merge(Data2=join_3)  # -> flatten(Result)
curvepoint = PointOnCurve(merge, parameter=0.5)
pull = PullPoint(Point=curvepoint, Geometry=offset_curve, ClosestOnly=True)  # -> ClosestPoint, Distance
bnd = Bounds(Numbers=pull.Distance)
remap = RemapNumbers(Value=pull.Distance, Source=bnd, Target=Domain(0, 1))  # -> Mapped, Clipped

gradient = Gradient(
    LowerLimit=0,
    UpperLimit=1,
    Parameter=remap.Mapped,
    stops=[0: RGB(170, 27, 135), 0: RGB(120, 169, 78), 0: RGB(29, 108, 10), 0: RGB(106, 51, 1), 0: RGB(28, 189, 33), 0.103: RGB(0, 240, 140), 0.536: RGB(245, 130, 255), 0.965: RGB(255, 99, 206)])

c_script = CSharpScript(crv=merge, color=gradient)  # -> out, A; inputs crv: Curve, color: Color
# ---------- c_script: C# ----------
    var c = color.R + "," + color.G + "," + color.B;
    crv.SetUserString("color", c);
    A = crv;
# ---------- end c_script ----------

# ---- group: RH_OUT:edges
curve = Curve(flatten(c_script.A))
